# Grasshopper definition solarAnalysis.gh (Grasshopper 1.0.7)
# plug-ins: BH.UI.Grasshopper

ladybug = Ladybug_Ladybug()  # -> Vviiiiiiiiiizzz; plug-in component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
number_slider = Slider(33, range=0..100)
number_slider_2 = Slider(50, range=0..100)
number_slider_3 = Slider(2, range=0..10)
constructlocation = Ladybug_ConstructLocation(
    locationName="unknown_Location",
    latitude=number_slider_2,
    longitude=number_slider,
    timeZone=number_slider_3,
    elevation=0)  # -> location; plug-in component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
number_slider_4 = Slider(4, range=0..100)
number_slider_5 = Slider(15, range=0..100)
sunpath = Ladybug_SunPath(
    location=constructlocation,
    hour=number_slider_5,
    day=number_slider_4,
    month=12,
    timeStep=1,
    sunPathScale=Slider(1, range=0..1),
    dailyOrAnnualSunPath=True)  # -> readMe, sunVectors, sunAltitudes, sunAzimuths, port, sunSpheresMesh, sunPathCrvs, compassCrvs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; disabled; plug-in component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
location = Location(
    Latitude=number_slider_2,
    Longitude=number_slider,
    Elevation=0,
    UtcOffset=number_slider_3,
    Name="Kyiv",
    Component="BH.oM.Environment.Climate.Location")
crv = Curve(<curve referenced from the Rhino model>)
spacetime = SpaceTime(
    Location=location,
    Year=Slider(2020, range=0..10000),
    Month=Slider(7, range=0..10),
    Day=number_slider_4,
    Hour=number_slider_5,
    Component="BH.oM.Environment.Climate.SpaceTime")
solarposition = SolarPosition(SpaceTime=spacetime, Component="{ .SolarPosition")
mounthpaths = MounthPaths(SpaceTime=spacetime, Component="{ .MounthPaths")
tobhom = ToBHoM(RCurve=crv, Component="{ .ToBHoM")
hourpath = HourPath(SpaceTime=spacetime, Component="{ .HourPath")
cir = Circle(Plane=PlaneXY(0, 0, 0), Radius=1)
scale = Scale(Center=Point(0, 0, 0), Factor=Slider(200000, range=0..1000000))  # -> Geometry, Transform
solarvector = SolarVector(Sun=solarposition, Component="{ .SolarVector")
getproperty = GetProperty(PropName="Azimuth", Component="{ .GetProperty")
explode = Explode(Object=solarposition, Component="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")  # -> Azimuth, Altitude, Sunrise, Sunset, BHoM_Guid, Name, Fragments, Tags, CustomData
line = LineSDL(Start="0,0,0", Direction=solarvector, Length=1)
panel = Panel(explode.Sunrise)
line_2 = LineSDL(Start="0,0,0", Direction=Vector(0, 0, 1), Length=Slider(500, range=0..1000))
